# Dynamo graph Bridge .dyn "Old Bridge" (Dynamo 2.12.0.5650)

# group: First 3 Points
byCoordinates = Point.ByCoordinates(lacing=Shortest)
code_block = CodeBlock { 0; 4; 12; 25; }
byCoordinates_2 = Point.ByCoordinates(x=code_block.out2, y=code_block.out1, z=code_block.out2, lacing=Shortest)
byCoordinates_3 = Point.ByCoordinates(x=code_block.out3, z=code_block.out0, lacing=Shortest)

# group: Arc
byThreePoints = Arc.ByThreePoints(firstPoint=byCoordinates, secondPoint=byCoordinates_2, thirdPoint=byCoordinates_3)
code_block_2 = CodeBlock { 0..1..0.10; }
pointAtParameter = Curve.PointAtParameter(curve=byThreePoints, param=code_block_2)
code_block_3 = CodeBlock { 0..1; 1; }
sublists = List.Sublists(list=pointAtParameter, ranges=code_block_3.out0, offset=code_block_3.out1)
code_block_4 = CodeBlock { -1; }
dropItems = List.DropItems(list=sublists, amount=code_block_4)

# group: Adaptive Components To Revit
family_types = FamilyTypes("AdaptiveFamilyPipe:AdaptiveFamilyPipe")
byPoints = AdaptiveComponent.ByPoints(points=dropItems, familyType=family_types)

# group: Distance & Remap Range
code_block_5 = CodeBlock { 0.5; }
pointAtParameter_2 = Curve.PointAtParameter(curve=byThreePoints, param=code_block_5)
distanceTo = Geometry.DistanceTo(geometry=dropItems, other=pointAtParameter_2)
flatten = List.Flatten(list=distanceTo)
code_block_6 = CodeBlock { 0.05; 0.2; }
remapRange = Math.RemapRange(numbers=flatten, newMin=code_block_6.out0, newMax=code_block_6.out1)
code_block_7 = CodeBlock { 0..1; 2; }
sublists_2 = List.Sublists(list=remapRange, ranges=code_block_7.out0, offset=code_block_7.out1)

# group: Change Arc Radius'
flatten_2 = List.Flatten(list=byPoints)
code_block_8 = CodeBlock { ["r1","r2"]; }
setParameterByName = Element.SetParameterByName(element=flatten_2, parameterName=code_block_8@L1, value=sublists_2)

# group: Base Geometry
list_create = List.Create(item0=pointAtParameter, item1=pointAtParameter)
flatten_3 = List.Flatten(list=list_create)
byStartPointEndPoint = Line.ByStartPointEndPoint(startPoint=byCoordinates, endPoint=byCoordinates_3)
code_block_9 = CodeBlock { [4,-4]; }
byCoordinates_4 = Vector.ByCoordinates(y=code_block_9, lacing=CrossProduct)
translate = Geometry.Translate(geometry=byStartPointEndPoint, direction=byCoordinates_4)
code_block_10 = CodeBlock { 0..1..0.10; }
pointAtParameter_3 = Curve.PointAtParameter(curve=translate, param=code_block_10, lacing=CrossProduct)
flatten_4 = List.Flatten(list=pointAtParameter_3)

# group: Base Lines To Revit
byStartPointEndPoint_2 = Line.ByStartPointEndPoint(startPoint=flatten_3, endPoint=flatten_4, lacing=Shortest)
addItemToEnd = List.AddItemToEnd()  # unwired: item, list
combine = List.Combine(combineFunction=addItemToEnd, list0=flatten_3, list1=flatten_4)
code_block_11 = CodeBlock(L=translate) { L; s1 = Geometry.Curve.StartPoint(L); e1 = Geometry.Curve.EndPoint(L); [[s1[0],e1[0]],[s1[1],e1[1]]]; }
join = List.Join(list0=combine, list1=code_block_11.out3)
family_types_2 = FamilyTypes("AdaptiveFamilyPipe:AdaptiveFamilyPipe")
byPoints_2 = AdaptiveComponent.ByPoints(points=join, familyType=family_types_2)

# group: Change Base Radius'
flatten_5 = List.Flatten(list=byPoints_2)
code_block_12 = CodeBlock { ["r1","r2"]; [0.1,0.1]; }
setParameterByName_2 = Element.SetParameterByName(element=byPoints_2, parameterName=code_block_12.out0, value=code_block_12.out1, lacing=CrossProduct)

# group: Surface By Loft
code_block_13 = CodeBlock { [2,-2]; }
byCoordinates_5 = Vector.ByCoordinates(y=code_block_13, lacing=CrossProduct)
translate_2 = Geometry.Translate(geometry=byStartPointEndPoint, direction=byCoordinates_5)
byLoft = Surface.ByLoft(crossSections=translate_2, guideCurves=translate_2)
code_block_14 = CodeBlock { 0.5; }
thicken = Surface.Thicken(surface=byLoft, thickness=code_block_14)
